# Grasshopper definition regular tetrahedron.gh (Grasshopper 1.0.7)
# plug-ins: Kangaroo2 Components, GhPolyhedra

vec = VectorXYZ(XComponent=Slider(0, range=0..50), YComponent=Slider(0, range=0..50), ZComponent=Slider(0, range=0..50))  # -> Vector, Length
sqrt = SquareRoot(Value=Slider(2, range=0..50))
division = Division(A=sqrt, B=Slider(4, range=0..50))
vec_2 = VectorXYZ(XComponent=Slider(0, range=0..50), YComponent=Slider(0, range=0..50), ZComponent=division)  # -> Vector, Length
X = UnitX(Factor=1)
Y = UnitY(Factor=1)
Z = UnitZ(Factor=1)
_4face = GhPythonScript()  # -> out, a, b
# ---------- _4face: Python ----------
__author__ = "sator"
__version__ = "2023.04.28"

import rhinoscriptsyntax as rs
import math

faces = []
triangle_points = []

for i in range(0, 3):
    angle = 2.0 * math.pi / 3 * i
    triangle_points.append(rs.CreatePoint([math.cos(angle), math.sin(angle), 0]))

triangle_points.append(rs.CreatePoint([0, 0, math.sqrt(2)]));


faces.append(rs.AddSrfPt([triangle_points[2], triangle_points[1], triangle_points[0]]))
faces.append(rs.AddSrfPt([triangle_points[0], triangle_points[1], triangle_points[3]]))
faces.append(rs.AddSrfPt([triangle_points[1], triangle_points[2], triangle_points[3]]))
faces.append(rs.AddSrfPt([triangle_points[2], triangle_points[0], triangle_points[3]]))

a = faces
# ---------- end _4face ----------
ln = Line(StartPoint=X, EndPoint=vec.Vector)
vec_3 = VectorXYZ(XComponent=Slider(0, range=0..50), YComponent=Slider(0, range=0..50), ZComponent=Slider(0, range=0..50))  # -> Vector, Length
ln_2 = Line(StartPoint=Y, EndPoint=vec.Vector)
ln_3 = Line(StartPoint=Z, EndPoint=vec.Vector)
subtraction = Subtraction(A=vec_3.Vector, B=vec_2.Vector)
move = Move(Geometry=_4face.a, Motion=subtraction)  # -> Geometry, Transform
rad = Radians(Degrees=Slider(180, range=0..360))
rotax = RotateAxis(Geometry=move.Geometry, Angle=rad, Axis=ln)  # -> Geometry, Transform
rad_2 = Radians(Degrees=Slider(125, range=0..360))
rotax_2 = RotateAxis(Geometry=rotax.Geometry, Angle=rad_2, Axis=ln_2)  # -> Geometry, Transform
pcen = PolygonCenter(Polyline=rotax_2.Geometry)  # -> CenterV, CenterE, CenterA
del = DelaunayMesh(Points=reverse(pcen.CenterV), Plane=PlaneXY(0, 0, 0))
del_2 = DelaunayMesh(Points=pcen.CenterV, Plane=PlaneXY(0, 0, 0))
merge = Merge(Data1=del, Data2=del_2)
mjoin = MeshJoin(Meshes=merge)
faceb = FaceBoundaries(Mesh=mjoin)
boundary = BoundarySurfaces(Edges=faceb)
bvol = BoundaryVolume(Boundaries=rotax_2.Geometry)
bvol_2 = BoundaryVolume(Boundaries=boundary)
scale = Scale(Geometry=bvol_2, Center=vec.Vector, Factor=Slider(3, range=0.001..10))  # -> Geometry, Transform
sint = SolidIntersection(BrepsA=bvol, BrepsB=scale.Geometry)
preview = CustomPreview(
    Geometry=sint,
    Material={diffuse=RGB(221, 160, 221), emission=RGB(66, 48, 66), shine=0.5, specular=RGB(255, 255, 255), transparency=0})
debrep = DeconstructBrep(Brep=sint)  # -> Faces, Edges, Vertices
crv = Curve(debrep.Edges)
pipe = Pipe(Curve=crv, Radius=Slider(0.003, range=0..1), Caps=0)
preview_2 = CustomPreview(Geometry=flatten(pipe), Material=ColourSwatch(SwatchColor=RGB(23, 232, 61)))
midpt = CurveMiddle(Curve=crv)
pdecon = Deconstruct(Point=midpt)  # -> XComponent, YComponent, ZComponent
sort = SortList(Keys=pdecon.ZComponent, ValuesA=crv)  # -> Keys, ValuesA
rev = ReverseList(List=sort.ValuesA)
item = ListItem(List=rev, Index=Slider(0, range=0..10), Wrap=True)
partition = PartitionList(List=rev, Size=Slider(4, range=0..10))
midpt_2 = CurveMiddle(Curve=partition)
fcircle = CircleFit(Points=midpt_2)  # -> Circle, Radius, Deviation
crv_cp = CurveClosestPoint(Point=midpt_2, Curve=fcircle.Circle)  # -> Point, Parameter, Distance
sort_2 = SortList(Keys=crv_cp.Parameter, ValuesA=partition)  # -> Keys, ValuesA
crv_2 = Curve(flatten(sort_2.ValuesA))  # disabled
lng = ListLength(List=flatten(sort_2.ValuesA))
end = EndPoints(Curve=sort_2.ValuesA)  # -> Start, End
midpt_3 = CurveMiddle(Curve=crv_2)
series = Series(Start=0, Step=1, Count=flatten(lng))
item_2 = ListItem(List=crv_2, Index=Slider(0, range=0..10), Wrap=True)
points = PointList(Points=midpt_3)
mod = Modulus(A=series, B=Slider(2, range=0..10))
dispatch = Dispatch(List=sort_2.ValuesA, DispatchPattern=mod)  # -> ListA, ListB
crv_3 = Curve(dispatch.ListB)
crv_4 = Curve(dispatch.ListA)
crv_5 = Curve(crv_4)
end_2 = EndPoints(Curve=crv_3)  # -> Start, End
pt = Point(end_2.End)
end_3 = EndPoints(Curve=crv_5)  # -> Start, End
pt_2 = Point(end_2.Start)
pdecon_2 = Deconstruct(Point=pt)  # -> XComponent, YComponent, ZComponent
pdecon_3 = Deconstruct(Point=pt_2)  # -> XComponent, YComponent, ZComponent
pt_3 = Point(end_3.End)
pt_4 = Point(end_3.Start)
pdecon_4 = Deconstruct(Point=pt_3)  # -> XComponent, YComponent, ZComponent
pdecon_5 = Deconstruct(Point=pt_4)  # -> XComponent, YComponent, ZComponent
larger = LargerThan(FirstNumber=pdecon_3.ZComponent, SecondNumber=pdecon_2.ZComponent)  # -> LargerThan, OrEqualTo
dispatch_2 = Dispatch(List=crv_3, DispatchPattern=larger.LargerThan)  # -> ListA, ListB
index = ItemIndex(List=crv_3, Item=dispatch_2.ListA)
smaller = SmallerThan(FirstNumber=pdecon_5.ZComponent, SecondNumber=pdecon_4.ZComponent)  # -> SmallerThan, OrEqualTo
dispatch_3 = Dispatch(List=crv_5, DispatchPattern=smaller.SmallerThan)  # -> ListA, ListB
index_2 = ItemIndex(List=crv_5, Item=dispatch_3.ListA)
flip = FlipCurve(Curve=dispatch_2.ListA)  # -> Curve, Flag
flip_2 = FlipCurve(Curve=dispatch_3.ListA)  # -> Curve, Flag
replace = ReplaceItems(List=crv_3, Item=flip.Curve, Indices=index, Wrap=False)
replace_2 = ReplaceItems(List=crv_5, Item=flip_2.Curve, Indices=index_2, Wrap=False)
midpt_4 = CurveMiddle(Curve=replace)
midpt_5 = CurveMiddle(Curve=replace_2)
pdecon_6 = Deconstruct(Point=midpt_4)  # -> XComponent, YComponent, ZComponent
pdecon_7 = Deconstruct(Point=midpt_5)  # -> XComponent, YComponent, ZComponent
smaller_2 = SmallerThan(FirstNumber=pdecon_6.ZComponent, SecondNumber=Slider(0, range=0..10))  # -> SmallerThan, OrEqualTo
dispatch_4 = Dispatch(List=replace, DispatchPattern=smaller_2.SmallerThan)  # -> ListA, ListB
index_3 = ItemIndex(List=replace, Item=dispatch_4.ListA)
smaller_3 = SmallerThan(FirstNumber=pdecon_7.ZComponent, SecondNumber=Slider(0, range=0..10))  # -> SmallerThan, OrEqualTo
dispatch_5 = Dispatch(List=replace_2, DispatchPattern=smaller_3.SmallerThan)  # -> ListA, ListB
index_4 = ItemIndex(List=replace_2, Item=dispatch_5.ListA)
flip_3 = FlipCurve(Curve=dispatch_4.ListA)  # -> Curve, Flag
flip_4 = FlipCurve(Curve=dispatch_5.ListA)  # -> Curve, Flag
replace_3 = ReplaceItems(List=replace, Item=flip_3.Curve, Indices=index_3, Wrap=False)
replace_4 = ReplaceItems(List=replace_2, Item=flip_4.Curve, Indices=index_4, Wrap=False)
end_4 = EndPoints(Curve=replace_4)  # -> Start, End
pdecon_8 = Deconstruct(Point=end_4.Start)  # -> XComponent, YComponent, ZComponent
pdecon_9 = Deconstruct(Point=end_4.End)  # -> XComponent, YComponent, ZComponent
subtraction_2 = Subtraction(A=pdecon_8.ZComponent, B=pdecon_9.ZComponent)
abs = Absolute(Value=subtraction_2)
smaller_4 = SmallerThan(FirstNumber=abs, SecondNumber=Slider(0.01, range=0..1))  # -> SmallerThan, OrEqualTo
dispatch_6 = Dispatch(List=replace_4, DispatchPattern=smaller_4.SmallerThan)  # -> ListA, ListB
index_5 = ItemIndex(List=replace_4, Item=dispatch_6.ListA)
flip_5 = FlipCurve(Curve=dispatch_6.ListA)  # -> Curve, Flag
replace_5 = ReplaceItems(List=replace_4, Item=flip_5.Curve, Indices=index_5, Wrap=False)
panel = Panel("0.604207")
line = Line(replace_3)
line_2 = Line(replace_5)
num = Number(Slider(0.99, range=0.01..0.99))
c_script = CSharpScript()  # -> out, A
# ---------- c_script: C# ----------
    var activeView = Rhino.RhinoDoc.ActiveDoc.Views.ActiveView;

    A = activeView;

    var cycles = activeView.RealtimeDisplayMode;
    var oldpasses = cycles.MaxPasses;
    cycles.PostEffectsOn = true;
    cycles.MaxPasses = 2;
    cycles.Paused = true;


    var viewCapture = new Rhino.Display.ViewCapture();
    viewCapture.Width = 1960;
    viewCapture.Height = 1080;
    viewCapture.ScaleScreenItems = false;
    viewCapture.DrawAxes = false;
    viewCapture.DrawGrid = false;
    viewCapture.DrawGridAxes = false;
    viewCapture.TransparentBackground = true;
    viewCapture.RealtimeRenderPasses = 10;

    var bitmap = viewCapture.CaptureToBitmap(activeView);
    A = bitmap;

    string filename;
    List<string> images = new List<string>();
    filename = string.Format("{0}_0.png", "C:/");
    images.Add(filename);
    bitmap.Save(filename);
# ---------- end c_script ----------
eval = EvaluateLength(Curve=line_2, Length=num, Normalized=True)  # -> Point, Tangent, Parameter
eval_2 = EvaluateLength(Curve=line, Length=num, Normalized=True)  # -> Point, Tangent, Parameter
panel_2 = Panel(c_script.A)
merge_2 = Merge(Data1=flatten(eval.Point), Data2=flatten(eval_2.Point))
pt_5 = Point(merge_2)  # disabled
quickhull = QuickHull(Points=merge_2)  # -> Curves, Mesh
boundary_2 = BoundarySurfaces(Edges=quickhull.Curves)
pt_6 = Point(graft(pt_5))
bvol_3 = BoundaryVolume(Boundaries=boundary_2)
difference = SetDifference(SetA=pt_5, SetB=pt_6)
preview_3 = CustomPreview(Geometry=bvol_3, Material=ColourSwatch(SwatchColor=RGB(181, 65, 65)))
sph = Sphere(Base=merge_2, Radius=Slider(0.012, range=0..1))
pipe_2 = Pipe(Curve=quickhull.Curves, Radius=Slider(0.003, range=0..1), Caps=0)
pt_7 = Point(merge_2)  # disabled
cps = ClosestPoints(Point=pt_6, Cloud=difference, Count=Slider(5, range=0..10))  # -> ClosestPoint, CPIndex, Distance
preview_4 = CustomPreview(Geometry=flatten(pipe_2), Material=ColourSwatch(SwatchColor=RGB(128, 23, 232)))
ln_4 = Line(StartPoint=cps.ClosestPoint, EndPoint=pt_6)
preview_5 = CustomPreview(Geometry=flatten(sph), Material=ColourSwatch(SwatchColor=RGB(128, 23, 232)))
line_3 = Line(flatten(ln_4))
dupln = RemoveDuplicateLines(Lines=line_3, Tolerance=0.01)
pdecon_10 = Deconstruct(Point=pt_7)  # -> XComponent, YComponent, ZComponent
pdecon_11 = Deconstruct(Point=pt_7)  # -> XComponent, YComponent, ZComponent
pdecon_12 = Deconstruct(Point=pt_7)  # -> XComponent, YComponent, ZComponent
line_4 = Line(graft(dupln))
line_5 = Line(dupln)
sort_3 = SortList(Keys=pdecon_10.ZComponent, ValuesA=pt_7)  # -> Keys, ValuesA
sort_4 = SortList(Keys=pdecon_11.YComponent, ValuesA=pt_7)  # -> Keys, ValuesA
sort_5 = SortList(Keys=pdecon_12.XComponent, ValuesA=pt_7)  # -> Keys, ValuesA
lng_2 = ListLength(List=sort_3.ValuesA)
lng_3 = ListLength(List=sort_4.ValuesA)
lng_4 = ListLength(List=sort_5.ValuesA)
lng_5 = ListLength(List=pt_7)
ma = MassAddition(Input=pt_7)  # -> Result, PartialResults
subtraction_3 = Subtraction(A=lng_2, B=Slider(1, range=0..1))
subtraction_4 = Subtraction(A=lng_3, B=Slider(1, range=0..1))
subtraction_5 = Subtraction(A=lng_4, B=Slider(1, range=0..1))
division_2 = Division(A=ma.Result, B=lng_5)
item_3 = ListItem(List=sort_3.ValuesA, Index=subtraction_3, Wrap=True)
item_4 = ListItem(List=sort_3.ValuesA, Index=Slider(0, range=0..1), Wrap=True)
item_5 = ListItem(List=sort_5.ValuesA, Index=subtraction_5, Wrap=True)
item_6 = ListItem(List=sort_5.ValuesA, Index=Slider(0, range=0..1), Wrap=True)
item_7 = ListItem(List=sort_4.ValuesA, Index=Slider(0, range=0..1), Wrap=True)
item_8 = ListItem(List=sort_4.ValuesA, Index=subtraction_4, Wrap=True)
midpt_6 = CurveMiddle(Curve=line_5)
midpt_7 = CurveMiddle(Curve=line_4)
dist = Distance(PointA=midpt_7, PointB=midpt_6)
sort_6 = SortList(Keys=dist, ValuesA=line_5)  # -> Keys, ValuesA
merge_3 = Merge(Data1=item_6, Data2=item_5, Data3=item_7, Data4=item_8, Data5=item_4, Data6=item_3)
index_6 = ItemIndex(List=sort_6.ValuesA, Item=sort_6.ValuesA)
point_cloud = Point(pt_7)
smaller_5 = SmallerThan(FirstNumber=index_6, SecondNumber=Slider(5, range=0..31))  # -> SmallerThan, OrEqualTo
equals = Equality(FirstNumber=index_6, SecondNumber=Slider(0, range=0..31))  # -> Equality, Inequality
ln_5 = Line(StartPoint=item_6, EndPoint=item_7)
ln_6 = Line(StartPoint=item_6, EndPoint=item_4)
ln_7 = Line(StartPoint=item_6, EndPoint=item_7)
ln_8 = Line(StartPoint=item_6, EndPoint=item_3)
ln_9 = Line(StartPoint=item_5, EndPoint=item_7)
ln_10 = Line(StartPoint=item_5, EndPoint=item_4)
ln_11 = Line(StartPoint=item_6, EndPoint=item_8)
ln_12 = Line(StartPoint=item_6, EndPoint=item_3)
ln_13 = Line(StartPoint=item_6, EndPoint=item_8)
ln_14 = Line(StartPoint=item_6, EndPoint=item_4)
ln_15 = Line(StartPoint=item_5, EndPoint=item_7)
ln_16 = Line(StartPoint=item_5, EndPoint=item_3)
ln_17 = Line(StartPoint=item_5, EndPoint=item_8)
ln_18 = Line(StartPoint=item_5, EndPoint=item_3)
ln_19 = Line(StartPoint=item_5, EndPoint=item_8)
ln_20 = Line(StartPoint=item_5, EndPoint=item_4)
and = GateAnd(A=equals.Inequality, B=smaller_5.SmallerThan)
edgesrf = EdgeSurface(CurveA=ln_5, CurveB=ln_6)
dispatch_7 = Dispatch(List=sort_6.ValuesA, DispatchPattern=and)  # -> ListA, ListB
edgesrf_2 = EdgeSurface(CurveA=ln_7, CurveB=ln_8)
edgesrf_3 = EdgeSurface(CurveA=ln_9, CurveB=ln_10)
edgesrf_4 = EdgeSurface(CurveA=ln_11, CurveB=ln_12)
edgesrf_5 = EdgeSurface(CurveA=ln_13, CurveB=ln_14)
edgesrf_6 = EdgeSurface(CurveA=ln_15, CurveB=ln_16)
edgesrf_7 = EdgeSurface(CurveA=ln_17, CurveB=ln_18)
edgesrf_8 = EdgeSurface(CurveA=ln_19, CurveB=ln_20)
midpt_8 = CurveMiddle(Curve=dispatch_7.ListA)
fcircle_2 = CircleFit(Points=midpt_8)  # -> Circle, Radius, Deviation
null = NullItem(Item=fcircle_2.Circle)  # -> NullFlags, InvalidFlags, Description
line_6 = Line(line_4)
dispatch_8 = Dispatch(List=fcircle_2.Circle, DispatchPattern=null.NullFlags)  # -> ListA, ListB
crv_cp_2 = CurveClosestPoint(Point=midpt_8, Curve=dispatch_8.ListB)  # -> Point, Parameter, Distance
center_point = Point(division_2)
difference_2 = SetDifference(SetA=point_cloud, SetB=merge_3)
merge_4 = Merge(
    Data1=edgesrf,
    Data2=edgesrf_2,
    Data3=edgesrf_5,
    Data4=edgesrf_4,
    Data5=edgesrf_3,
    Data6=edgesrf_6,
    Data7=edgesrf_8,
    Data8=edgesrf_7)
sort_7 = SortList(Keys=crv_cp_2.Parameter, ValuesA=dispatch_7.ListA)  # -> Keys, ValuesA
edgesrf_9 = EdgeSurface(CurveA=line_6, CurveB=sort_7.ValuesA)  # -> flatten(Surface)
item_9 = ListItem(List=merge_4, Index=Slider(0, range=0..1), Wrap=True)
pt_8 = Point(difference_2)
number_slider = Slider(0, range=0..31)
srf = Surface(graft(edgesrf_9))
facen = FaceNormals(Mesh=item_9)  # -> Centers, Normals
subtraction_6 = Subtraction(A=pt_8, B=center_point)
mesh_uv = MeshSurface(Surface=srf, UCount=5, VCount=5, Overhang=True, Equalize=False)
vec_4 = VectorXYZ(XComponent=number_slider, YComponent=number_slider, ZComponent=number_slider)  # -> Vector, Length
dprod = DotProduct(VectorA=facen.Normals, VectorB=subtraction_6, Unitize=False)
facen_2 = FaceNormals(Mesh=mesh_uv)  # -> Centers, Normals
larger_2 = LargerThan(FirstNumber=dprod, SecondNumber=Slider(0, range=0..1))  # -> LargerThan, OrEqualTo
pt_9 = Point(vec_4.Vector)
subtraction_7 = Subtraction(A=pt_9, B=facen_2.Centers)
dispatch_9 = Dispatch(List=pt_8, DispatchPattern=larger_2.LargerThan)  # -> ListA, ListB
dprod_2 = DotProduct(VectorA=facen_2.Normals, VectorB=subtraction_7, Unitize=False)
srf_cp = SurfaceClosestPoint(Point=dispatch_9.ListA, Surface=item_9)  # -> Point, UVPoint, Distance
larger_3 = LargerThan(FirstNumber=dprod_2, SecondNumber=Slider(0, range=0..31))  # -> LargerThan, OrEqualTo
sort_8 = SortList(Keys=srf_cp.Distance, ValuesA=dispatch_9.ListA)  # -> Keys, ValuesA
dispatch_10 = Dispatch(List=srf, DispatchPattern=larger_3.LargerThan)  # -> ListA, ListB
item_10 = ListItem(List=sort_8.ValuesA, Index=0, Wrap=True)
points_2 = PointList(Points=item_10)
srf_2 = Surface(flatten(dispatch_10.ListA))
bvol_4 = BoundaryVolume(Boundaries=srf_2)
edges = BrepEdges(Brep=bvol_4)  # -> Naked, Interior, NonManifold
preview_6 = CustomPreview(
    Geometry=bvol_4,
    Material={diffuse=RGB(221, 160, 221), emission=RGB(66, 48, 66), shine=0.5, specular=RGB(255, 255, 255), transparency=0})
dupln_2 = RemoveDuplicateLines(Lines=edges.Interior, Tolerance=0.01)
division_3 = Division(A=Slider(1, range=0..31), B=Slider(3, range=0..31))
subtraction_8 = Subtraction(A=Slider(1, range=0..31), B=division_3)
line_7 = Line(dupln_2)
pcen_2 = PolygonCenter(Polyline=srf_2)  # -> CenterV, CenterE, CenterA
eval_3 = EvaluateCurve(Curve=line_7, Parameter=subtraction_8)  # -> Point, Tangent, Angle
eval_4 = EvaluateCurve(Curve=line_7, Parameter=division_3)  # -> Point, Tangent, Angle
pt_10 = Point(graft(pcen_2.CenterV))
pt_11 = Point(pcen_2.CenterV)
merge_5 = Merge(Data1=eval_3.Point, Data2=eval_4.Point)
duppt = RemoveDuplicatePts(Points=merge_5, Tolerance=0.01)
cps_2 = ClosestPoints(Point=pt_10, Cloud=pt_11, Count=Slider(10, range=0..31))  # -> ClosestPoint, CPIndex, Distance
pt_12 = Point(duppt)
pt_13 = Point(graft(duppt))
ln_21 = Line(StartPoint=pt_10, EndPoint=cps_2.ClosestPoint)
index_7 = ItemIndex(List=pt_12, Item=pt_12)
index_8 = ItemIndex(List=pt_12, Item=pt_13)
equals_2 = Equality(FirstNumber=index_8, SecondNumber=index_7)  # -> Equality, Inequality
dispatch_11 = Dispatch(List=pt_12, DispatchPattern=equals_2.Inequality)  # -> ListA, ListB
cps_3 = ClosestPoints(Point=pt_13, Cloud=dispatch_11.ListA, Count=Slider(3, range=0..31))  # -> ClosestPoint, CPIndex, Distance
ln_22 = Line(StartPoint=pt_13, EndPoint=cps_3.ClosestPoint)  # -> flatten(Line)
dupln_3 = RemoveDuplicateLines(Lines=ln_22, Tolerance=0.01)
line_8 = Line(dupln_3)
line_9 = Line(graft(dupln_3))
end_5 = EndPoints(Curve=line_8)  # -> Start, End
merge_6 = Merge(Data1=end_5.Start, Data2=end_5.End)
duppt_2 = RemoveDuplicatePts(Points=merge_6, Tolerance=0.01)
len = Length(Curve=line_9)
pt_14 = Point(duppt_2)
multiplication = Multiplication(A=len, B=Slider(0.058, range=0..1))
msphere = MeshSphere(Base=pt_14, Radius=multiplication, UCount=10, VCount=20)  # -> flatten(Mesh)
pipe_3 = Pipe(Curve=line_9, Radius=multiplication, Caps=0)  # -> flatten(Pipe)
merge_7 = Merge(Data1=pipe_3, Data2=msphere)
number_slider_2 = Slider(0, range=0..31)
vec_5 = VectorXYZ(XComponent=Slider(0, range=0..31), YComponent=Slider(18, range=0..31), ZComponent=Slider(6, range=0..31))  # -> Vector, Length
vec_6 = VectorXYZ(XComponent=number_slider_2, YComponent=number_slider_2, ZComponent=number_slider_2)  # -> Vector, Length
ln_23 = Line(StartPoint=vec_5.Vector, EndPoint=vec_6.Vector)
rotax_3 = RotateAxis(Geometry=merge_7, Angle=Slider(32, range=0..32), Axis=ln_23)  # -> Geometry, Transform
