# Grasshopper definition soccer_ball.gh (Grasshopper 1.0.7)

number_slider = Slider(7, range=0..100)
a_x_y = GhPythonScript(x=number_slider, y=Slider(2, range=0..100))  # -> out, a
# ---------- a_x_y: Python ----------
__author__ = "sator"
__version__ = "2023.04.26"

import rhinoscriptsyntax as rs

a = x * y
# ---------- end a_x_y ----------
a_x_y_2 = GhPythonScript(x=Slider(1, range=0..100), y=Slider(5, range=0..100))  # -> out, a
# ---------- a_x_y_2: Python ----------
__author__ = "sator"
__version__ = "2023.04.26"

import rhinoscriptsyntax as rs

a = x / y
# ---------- end a_x_y_2 ----------
radgrid = Radial(Plane=PlaneXY(0, 0, 0), Size=number_slider, ExtentR=Slider(1, range=0..100), ExtentP=Slider(5, range=0..100))  # -> Cells, Points
panel = Panel(radgrid.Points)
pi = Pi(Factor=a_x_y_2.a)
item = ListItem(List=radgrid.Points, Index=Slider(0, range=0..100), Wrap=True)
panel_2 = Panel(item)
rotate = Rotate(Geometry=radgrid.Points, Angle=pi, Plane=PlaneXY(0, 0, 0))  # -> Geometry, Transform
panel_3 = Panel(rotate.Geometry)
base_hexagon = SimpleMesh(Brep=radgrid.Cells)
origin = VectorXYZ(XComponent=Slider(0, range=0..10), YComponent=Slider(0, range=0..10), ZComponent=Slider(0, range=0..10))  # -> Vector, Length
scale = Scale(Geometry=rotate.Geometry, Center=origin.Vector, Factor=Slider(2, range=0..10))  # -> Geometry, Transform
vec2pt = Vector2Pt(PointA=scale.Geometry, PointB=origin.Vector, Unitize=False)  # -> Vector, Length
panel_4 = Panel(vec2pt.Vector)
python = GhPythonScript(x=base_hexagon, y=vec2pt.Vector)  # -> out, a
# ---------- python: Python ----------
__author__ = "sator"
__version__ = "2023.04.26"

import rhinoscriptsyntax as rs

a = []

a.append(x)

for p in y:
    print p
    
print "len(y) ={}".format(len(y))
for i in range(int((len(y) / 3))):
    print "i={}".format(i)
    print "({},{},{})".format(y[i])
        
    
    #rs.TransformObject(x, rs.XformTranslation(p))
    #a.append(x)
# ---------- end python ----------
