# Grasshopper definition unnamed.gh (Grasshopper 1.0.7)

number_slider = Slider(7, range=0..100)
a_x_y = GhPythonScript(x=number_slider, y=Slider(2, range=0..100))  # -> out, a
# ---------- a_x_y: Python ----------
__author__ = "sator"
__version__ = "2023.04.26"

import rhinoscriptsyntax as rs

a = x * y
# ---------- end a_x_y ----------
a_x_y_2 = GhPythonScript(x=Slider(1, range=0..100), y=Slider(5, range=0..100))  # -> out, a
# ---------- a_x_y_2: Python ----------
__author__ = "sator"
__version__ = "2023.04.26"

import rhinoscriptsyntax as rs

a = x / y
# ---------- end a_x_y_2 ----------
radgrid = Radial(Plane=PlaneXY(0, 0, 0), Size=number_slider, ExtentR=Slider(1, range=0..100), ExtentP=Slider(5, range=0..100))  # -> Cells, Points
pi = Pi(Factor=a_x_y_2.a)
rotate = Rotate(Geometry=radgrid.Points, Angle=pi, Plane=PlaneXY(0, 0, 0))  # -> Geometry, Transform
base_hexagon = SimpleMesh(Brep=radgrid.Cells)
origin = VectorXYZ(XComponent=Slider(0, range=0..10), YComponent=Slider(0, range=0..10), ZComponent=Slider(0, range=0..10))  # -> Vector, Length
scale = Scale(Geometry=rotate.Geometry, Center=origin.Vector, Factor=Slider(2, range=0..10))  # -> Geometry, Transform
python = GhPythonScript(x=scale.Geometry)  # -> out, a
# ---------- python: Python ----------
__author__ = "sator"
__version__ = "2023.04.26"

import rhinoscriptsyntax as rs

a = []

a.append(x)

for p in y:
    print "next p"
    if (p - [0,0,0]).length > 0.01:
        print p
    
    #rs.TransformObject(x, rs.XformTranslation(p))
    #a.append(x)
# ---------- end python ----------
