# Grasshopper definition boys_surf.gh (Grasshopper 1.0.7)
# plug-ins: Weaverbird, Kangaroo2 Components

mesh = Mesh(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)
wbloop = WeaverbirdsLoopSubdivision(MeshCurves=mesh, Level=3, SmoothNakedEdges=1)
medges = MeshEdges(Mesh=wbloop)  # -> NakedEdges, InteriorEdges, NonManifoldEdges
len = Length(Curve=medges.InteriorEdges)
avr = Average(Input=len)
smooth = Smooth(M=wbloop, Strength=2)
tangentincircles = TangentIncircles(Mesh=wbloop, Strength=10)
show = Show(G=wbloop)
length_line = LengthLine(Line=medges.InteriorEdges, Length=avr, Strength=0.01)
entwine = Entwine(Branch00=show, Branch01=[smooth, length_line, tangentincircles], FlattenInputs=True)
solver = Solver(GoalObjects=entwine, Reset=Button(), Threshold=1e-15, Tolerance=0.01, On=Toggle(True))  # -> I, V, O
bang = ExplodeTree(Data=solver.O)  # -> Branch0, Branch1
wbloop_2 = WeaverbirdsLoopSubdivision(MeshCurves=bang.Branch0, Level=2, SmoothNakedEdges=1)
