# Grasshopper definition surface_area.gh (Grasshopper 1.0.7)

animation_sequence = Slider(0, range=0..1)
number_slider = Slider(9.793809, range=0.1..30)
number_slider_2 = Slider(39.85, range=0.1..39.85)
number_slider_3 = Slider(39.85, range=0.1..39.85)
sph = Sphere(Base=PlaneXY(0, 0, 0), Radius=1)
vec = VectorXYZ(XComponent="25", YComponent="25", ZComponent="25")  # -> Vector, Length
panel = Panel("100")
number_slider_4 = Slider(1, range=0..1)
multiplication = Multiplication(A="3", B=number_slider_4)
subtraction = Subtraction(A="2", B=multiplication)
subtraction_2 = Subtraction(A="1", B=multiplication)
min = Minimum(A=subtraction, B="1")
max = Maximum(A=subtraction_2, B="0")
max_2 = Maximum(A=min, B="0")
_2º = PowerOf2(Value=Slider(9, range=-1..20))
move = Move(Geometry=sph, Motion=vec.Vector)  # -> Geometry, Transform
subtraction_3 = Subtraction(A="39.85", B="0.1")
subtraction_4 = Subtraction(A="39.85", B="0.1")
scale = Scale(Geometry=move.Geometry, Center=vec.Vector, Factor="20")  # -> Geometry, Transform
multiplication_2 = Multiplication(A=max_2, B=subtraction_3)
subtraction_5 = Subtraction(A="60", B="10")
multiplication_3 = Multiplication(A=max, B=subtraction_4)
panel_2 = Panel("20")
python = GhPythonScript(x=animation_sequence)  # -> out; disabled
# ---------- python: Python ----------
__author__ = "sator"
__version__ = "2023.07.07"

import rhinoscriptsyntax as rs
if x == 0:
    path = "result.txt"
    f = open(path, "w")
    f.write(str(0))
    f.close()
    
a = "do update!"
# ---------- end python ----------
z_range_min = Number("0")
z_range_max = Number("50")
domain_max = Number("50")
domain_min = Number("0")
dom = ConstructDomain(DomainStart=domain_min, DomainEnd=domain_max)
split_num = Number(_2º)
multiplication_4 = Multiplication(A=animation_sequence, B=split_num)
multiplication_5 = Multiplication(A=multiplication_4, B=split_num)
multiplication_6 = Multiplication(A=animation_sequence, B=split_num)
mod = Modulus(A=multiplication_5, B=split_num)
round = Round(Number=multiplication_6)  # -> Nearest, Floor, Ceiling
round_2 = Round(Number=mod)  # -> Nearest, Floor, Ceiling
y = Number(round_2.Floor)
x = Number(round.Floor)
range = Range(Domain=dom, Steps=split_num)
multiplication_7 = Multiplication(A=number_slider_4, B=subtraction_5)
addition = Addition(A=multiplication_2, B="0.1")
range_2 = Range(Domain=dom, Steps=split_num)
multiplication_8 = Multiplication()
addition_2 = Addition(A=multiplication_3, B="0.1")
multiplication_9 = Multiplication(A=Slider(0.435, range=0..1), B=domain_max)
vec_2 = VectorXYZ(XComponent="5", YComponent="5", ZComponent="5")  # -> Vector, Length
vec_3 = VectorXYZ(XComponent="5", YComponent="5", ZComponent="5")  # -> Vector, Length
multiplication_10 = Multiplication(A=Slider(0.697, range=0..1), B=domain_max)
rectangle = Rectangle(Plane=PlaneXY(0, 0, 0), XSize="40", YSize="40", Radius=0)  # -> Rectangle, Length
rectangle_2 = Rectangle(Plane=PlaneXY(0, 0, 0), XSize="40", YSize="40", Radius=0)  # -> Rectangle, Length
addition_3 = Addition(A=multiplication_7, B="10")
item = ListItem(List=range_2, Index=y, Wrap=True)
panel_4 = Panel(x)
item_2 = ListItem(List=range, Index=x, Wrap=True)
dx = Number(addition_2)
dy = Number(addition)
move_2 = Move(Geometry=rectangle.Rectangle, Motion=vec_2.Vector)  # -> Geometry, Transform
move_3 = Move(Geometry=rectangle_2.Rectangle, Motion=vec_3.Vector)  # -> Geometry, Transform
x_2 = Number(multiplication_9)
number_slider_5 = Slider(24, range=0..24)
y_2 = Number(multiplication_10)
number_slider_6 = Slider(24, range=0..24)
num = Number(graft(item_2))
srf = Surface(move_2.Geometry)
srf_2 = Surface(move_3.Geometry)
subtraction_6 = Subtraction(A="44.9", B=dx)
subtraction_7 = Subtraction(A="44.9", B=dy)
panel_5 = Panel(y)
rectangle_3 = Rectangle(Plane=PlaneXY(0, 0, 0), XSize=dx, YSize=dy, Radius=0)  # -> Rectangle, Length
vec_4 = VectorXYZ(XComponent=num, YComponent=item, ZComponent=0)  # -> flatten(Vector), Length
subtraction_8 = Subtraction(A=domain_min, B=domain_max)
vec_5 = VectorXYZ(XComponent=x_2, YComponent=y_2, ZComponent="5")  # -> Vector, Length
pcen = PolygonCenter(Polyline=srf)  # -> CenterV, CenterE, CenterA
sdivide = DivideSurface(Surface=srf, UCount=number_slider_5, VCount=number_slider_5)  # -> flatten(Points), Normals, Parameters
pcen_2 = PolygonCenter(Polyline=srf_2)  # -> CenterV, CenterE, CenterA
sdivide_2 = DivideSurface(Surface=srf_2, UCount=number_slider_6, VCount=number_slider_6)  # -> flatten(Points), Normals, Parameters
min_2 = Minimum(A=y_2, B=subtraction_7)
min_3 = Minimum(A=x_2, B=subtraction_6)
abs = Absolute(Value=subtraction_8)
vec_6 = VectorXYZ(XComponent=min_3, YComponent=min_2, ZComponent=0)  # -> Vector, Length
ln = Line(StartPoint=pcen.CenterV, EndPoint=sdivide.Points)
devec = DeconstructVector(Vector=sdivide_2.Points)  # -> XComponent, YComponent, ZComponent
division = Division(A=abs, B=split_num)
focuspoint = Vector(vec_5.Vector)
domain_width = Number(division)
move_4 = Move(Geometry=rectangle_3.Rectangle, Motion=vec_6.Vector)  # -> Geometry, Transform
len = Length(Curve=ln)  # -> simplify(Length)
sqr = Square(Value=devec.YComponent)
sqr_2 = Square(Value=devec.XComponent)
scale_2 = Number(addition_3)
vec_7 = Vector(graft(vec_4.Vector))
boundary = BoundarySurfaces(Edges=move_4.Geometry)
panel_6 = Panel(vec_7)
bnd = Bounds(Numbers=len)
multiplication_11 = Multiplication(A=sqr_2)
multiplication_12 = Multiplication(A=sqr)
scale_3 = Number(scale_2)
multiplication_13 = Multiplication(A=Slider(3, range=0..24), B="360")
remap = RemapNumbers(Value=len, Source=bnd, Target=multiplication_13)  # -> Mapped, Clipped
xy = XYPlane(Origin=Point(0, 0, 0))
addition_4 = Addition(A=multiplication_11, B=multiplication_12)
rectangle_4 = Rectangle(Plane=xy, XSize=domain_width, YSize=domain_width, Radius=0)  # -> Rectangle, Length
rad = Radians(Degrees=remap.Mapped)
subtraction_9 = Subtraction(A=addition_4, B=Slider(0, range=0..30500))
boundary_2 = BoundarySurfaces(Edges=rectangle_4.Rectangle)
sin = Sine(Value=rad)
move_5 = Move(Geometry=boundary_2, Motion=vec_7)  # -> Geometry, Transform
multiplication_14 = Multiplication(A=subtraction_9, B=Slider(0.010536, range=0..1))
z_range_min_2 = Number(z_range_min)
z_range_max_2 = Number(z_range_max)
multiplication_15 = Multiplication(A=sin, B=Slider(2, range=0..500))
Z = UnitZ(Factor=multiplication_15)
Z_2 = UnitZ(Factor=multiplication_14)
subtraction_10 = Subtraction(A=z_range_min_2, B=z_range_max_2)
move_6 = Move(Geometry=sdivide.Points, Motion=Z)  # -> flatten(Geometry), Transform
move_7 = Move(Geometry=sdivide_2.Points, Motion=Z_2)  # -> flatten(Geometry), Transform
addition_5 = Addition(A=number_slider_5, B="1")
addition_6 = Addition(A=number_slider_6, B="1")
abs_2 = Absolute(Value=subtraction_10)
z_range_width = Number(abs_2)
srfgrid = SurfaceFromPoints(Points=move_6.Geometry, UCount=addition_5, Interpolate=False)
srfgrid_2 = SurfaceFromPoints(Points=move_7.Geometry, UCount=addition_6, Interpolate=False)
Z_3 = UnitZ(Factor=abs_2)
extr = Extrude(Base=boundary, Direction=Z_3)
bvol = BoundaryVolume(Boundaries=extr)
extr_2 = Extrude(Base=move_5.Geometry, Direction=Z_3)
srf_3 = Surface(srfgrid)
bvol_2 = BoundaryVolume(Boundaries=extr_2)
swatch = ColourSwatch(SwatchColor=RGB(179, 72, 194))  # disabled
sint = SolidIntersection(BrepsA=srf_3, BrepsB=bvol)
preview = CustomPreview(Geometry=bvol_2, Material=swatch)  # disabled
null = NullItem(Item=sint)  # -> NullFlags, InvalidFlags, Description
and = GateAnd(A=null.NullFlags, B=null.InvalidFlags)
dispatch = Dispatch(List=sint, DispatchPattern=and)  # -> ListA, ListB
brep = Brep(flatten(dispatch.ListB))
debrep = DeconstructBrep(Brep=brep)  # -> Faces, Edges, Vertices
lng = ListLength(List=debrep.Faces)
vec_8 = Vector(focuspoint)  # disabled
equals = Equality(FirstNumber=lng, SecondNumber="6")  # -> Equality, Inequality
dispatch_2 = Dispatch(List=debrep.Faces, DispatchPattern=equals.Equality)  # -> ListA, ListB
panel_7 = Panel(lng)
srf_4 = Surface(flatten(dispatch_2.ListA))
vec_9 = VectorXYZ(XComponent=0, YComponent=0, ZComponent=0)  # -> Vector, Length; disabled
scale_4 = Scale(Geometry=srf_3, Center=vec_8, Factor=scale_3)  # -> Geometry, Transform; disabled
scale_5 = Scale(Geometry=brep, Center=vec_8, Factor=scale_3)  # -> Geometry, Transform; disabled
vec2pt = Vector2Pt(PointA=vec_8, PointB=vec_9.Vector, Unitize=False)  # -> Vector, Length; disabled
move_8 = Move(Geometry=scale_5.Geometry, Motion=vec2pt.Vector)  # -> Geometry, Transform; disabled
move_9 = Move(Geometry=scale_4.Geometry, Motion=vec2pt.Vector)  # -> Geometry, Transform; disabled
swatch_2 = ColourSwatch(SwatchColor=RGB(30, 230, 193))  # disabled
swatch_3 = ColourSwatch(SwatchColor=RGB(136, 250, 87))  # disabled
swatch_4 = ColourSwatch(SwatchColor=RGB(251, 164, 87))  # disabled
number_slider_7 = Slider(0.252, range=0..1)  # disabled
preview_2 = CustomPreview(Geometry=move_9.Geometry, Material=swatch_2)  # disabled
preview_3 = CustomPreview(Geometry=move_8.Geometry, Material=swatch_4)  # disabled
R = Number(number_slider_7)  # disabled
mesh = Mesh(srf_4)
demesh = DeconstructMesh(Mesh=mesh)  # -> Vertices, Faces, Colours, Normals
facen = FaceNormals(Mesh=srf_4)  # -> Centers, Normals
panel_8 = Panel("{0}")
Z_4 = UnitZ(Factor=1)
dprod = DotProduct(VectorA=demesh.Normals, VectorB=Z_4, Unitize=False)
number_slider_8 = Slider(2.211, range=1..4.001)  # disabled
avr = Average(Input=dprod)  # -> flatten(ArithmeticMean)
abs_3 = Absolute(Value=avr)
multiplication_16 = Multiplication(A=R, B=number_slider_8)  # disabled
smaller = SmallerThan(FirstNumber=abs_3, SecondNumber="0.001")  # -> SmallerThan, OrEqualTo
dispatch_3 = Dispatch(List=srf_4, DispatchPattern=smaller.SmallerThan)  # -> ListA, ListB
dispatch_4 = Dispatch(List=dispatch_3.ListB, DispatchPattern=smaller.SmallerThan)  # -> ListA, ListB
srf_5 = Surface(dispatch_4.ListA)
mesh_2 = Mesh(srf_5)
demesh_2 = DeconstructMesh(Mesh=mesh_2)  # -> Vertices, Faces, Colours, Normals
swatch_5 = ColourSwatch(SwatchColor=RGB(255, 0, 90))  # disabled
pdecon = Deconstruct(Point=demesh_2.Vertices)  # -> XComponent, YComponent, ZComponent
vec_10 = VectorXYZ(XComponent=pdecon.XComponent, YComponent=pdecon.YComponent, ZComponent=0)  # -> Vector, Length
z_range_width_2 = Number(z_range_width)
sort = SortList(Keys=vec_10.Length, ValuesA=demesh_2.Vertices)  # -> Keys, ValuesA
vec_11 = VectorXYZ(XComponent=z_range_width_2, YComponent=0, ZComponent=0)  # -> Vector, Length
vec_12 = VectorXYZ(XComponent=0, YComponent=z_range_width_2, ZComponent=0)  # -> Vector, Length
devec_2 = DeconstructVector(Vector=demesh_2.Vertices)  # -> XComponent, YComponent, ZComponent
lng_2 = ListLength(List=sort.ValuesA)
vec_13 = VectorXYZ(XComponent=devec_2.XComponent, YComponent=devec_2.YComponent, ZComponent=0)  # -> Vector, Length
subtraction_11 = Subtraction(A=lng_2, B="1")
item_3 = ListItem(List=sort.ValuesA, Index=0, Wrap=True)
addition_7 = Addition(A=item_3, B=vec_12.Vector)
item_4 = ListItem(List=sort.ValuesA, Index=subtraction_11, Wrap=True)
addition_8 = Addition(A=item_3, B=vec_11.Vector)
subtraction_12 = Subtraction(A=vec_13.Vector, B=addition_8)
subtraction_13 = Subtraction(A=vec_13.Vector, B=addition_7)
vlen = VectorLength(Vector=subtraction_12)
vlen_2 = VectorLength(Vector=subtraction_13)
sort_2 = SortList(Keys=vlen, ValuesA=demesh_2.Vertices)  # -> Keys, ValuesA
sort_3 = SortList(Keys=vlen_2, ValuesA=demesh_2.Vertices)  # -> Keys, ValuesA
srf_6 = Surface(srf_3)
item_5 = ListItem(List=sort_3.ValuesA, Index=0, Wrap=True)
item_6 = ListItem(List=sort_2.ValuesA, Index=0, Wrap=True)
addition_9 = Addition(A=item_6, B=item_5)
addition_10 = Addition(A=item_6, B=item_5)
division_2 = Division(A=addition_9, B="2")
subtraction_14 = Subtraction(A=addition_10, B=item_3)
neg = Negative(Value=division_2)
subtraction_15 = Subtraction(A=item_6, B=item_3)
subtraction_16 = Subtraction(A=item_5, B=item_3)
subtraction_17 = Subtraction(A=item_6, B=item_5)
ln_2 = Line(StartPoint=item_6, EndPoint=item_3)
scale_6 = Scale(Geometry=ln_2, Center=vec_8, Factor=scale_3)  # -> Geometry, Transform; disabled
move_10 = Move(Geometry=scale_6.Geometry, Motion=vec2pt.Vector)  # -> Geometry, Transform; disabled
end = EndPoints(Curve=move_10.Geometry)  # -> Start, End; disabled
vec2pt_2 = Vector2Pt(PointA=end.Start, PointB=end.End, Unitize=False)  # -> Vector, Length; disabled
ln_3 = Line(StartPoint=item_5, EndPoint=item_3)
scale_7 = Scale(Geometry=ln_3, Center=vec_8, Factor=scale_3)  # -> Geometry, Transform; disabled
move_11 = Move(Geometry=scale_7.Geometry, Motion=vec2pt.Vector)  # -> Geometry, Transform; disabled
end_2 = EndPoints(Curve=move_11.Geometry)  # -> Start, End; disabled
vec2pt_3 = Vector2Pt(PointA=end_2.Start, PointB=end_2.End, Unitize=False)  # -> Vector, Length; disabled
sph_2 = Sphere(Base=end_2.End, Radius=R)  # disabled
xprod = CrossProduct(VectorA=vec2pt_2.Vector, VectorB=vec2pt_3.Vector, Unitize=False)  # -> Vector, Length; disabled
merge = Merge(Data1=move_10.Geometry, Data2=move_11.Geometry)  # disabled
addition_11 = Addition(A=end_2.Start, B=vec2pt_2.Vector)  # disabled
addition_12 = Addition(A=end.Start, B=xprod.Vector)  # disabled
addition_13 = Addition(A=end.Start, B=vec2pt_3.Vector)  # disabled
addition_14 = Addition(A=end_2.Start, B=xprod.Vector)  # disabled
pipe = Pipe(Curve=merge, Radius=R, Caps=0)  # disabled
pl_3pt = Plane3Pt(PointA=end_2.Start, PointB=addition_11, PointC=addition_14)  # disabled
pl_3pt_2 = Plane3Pt(PointA=end.Start, PointB=addition_12, PointC=addition_13)  # disabled
merge_2 = Merge(Data1=pl_3pt_2, Data2=pl_3pt)  # disabled
cone = Cone(Base=merge_2, Radius=multiplication_16, Length=1)  # -> Cone, Tip; disabled
merge_3 = Merge(Data1=pipe, Data2=cone.Cone, Data3=sph_2)  # -> flatten(Result); disabled
preview_4 = CustomPreview(Geometry=merge_3, Material=swatch_5)  # disabled
points = PointList(Points=subtraction_14)
move_12 = Move(Geometry=srf_6, Motion=neg)  # -> Geometry, Transform
merge_4 = Merge(Data1=item_3, Data2=item_6, Data3=subtraction_14, Data4=item_5)
move_13 = Move(Geometry=mesh_2, Motion=neg)  # -> Geometry, Transform
vlen_3 = VectorLength(Vector=subtraction_17)
xprod_2 = CrossProduct(VectorA=subtraction_15, VectorB=subtraction_16, Unitize=False)  # -> Vector, Length
division_3 = Division(A="50", B=vlen_3)
conmesh = ConstructMesh(Vertices=merge_4, Faces={A=0, B=1, C=2, D=3})
scale_8 = Scale(Geometry=conmesh, Center=vec_8, Factor=scale_3)  # -> Geometry, Transform; disabled
move_14 = Move(Geometry=scale_8.Geometry, Motion=vec2pt.Vector)  # -> Geometry, Transform; disabled
preview_5 = CustomPreview(Geometry=move_14.Geometry, Material=swatch_3)  # disabled
move_15 = Move(Geometry=conmesh, Motion=neg)  # -> Geometry, Transform
num_2 = Number(number_slider_4)
num_3 = Number(flatten(xprod_2.Length))
multiplication_17 = Multiplication(A="1.6", B=num_2)
ma = MassAddition(Input=num_3)  # -> Result, PartialResults
scale_9 = Scale(Geometry=move_12.Geometry, Center=Point(0, 0, 0), Factor=division_3)  # -> Geometry, Transform
num_4 = Number(multiplication_17)
scale_10 = Scale(Geometry=move_15.Geometry, Center=Point(0, 0, 0), Factor=division_3)  # -> Geometry, Transform
scale_11 = Scale(Geometry=move_13.Geometry, Center=Point(0, 0, 0), Factor=division_3)  # -> Geometry, Transform
panel_9 = Panel(ma.Result)
python_2 = GhPythonScript(result=ma.Result)  # -> out, a
# ---------- python_2: Python ----------
__author__ = "sator"
__version__ = "2023.07.07"

import rhinoscriptsyntax as rs


path = 'result.txt'
print result
if result is not None:
    f = open(path, 'r')
    prev = float(f.read())
    f.close()
    
    f = open(path, 'w')
    f.write(str(prev + result))
    f.close()
# ---------- end python_2 ----------
Z_5 = UnitZ(Factor=1)
division_4 = Division(A=ma.Result, B="2")
rot3d = Rotate3D(Geometry=scale_10.Geometry, Angle=num_4, Center=Point(0, 0, 0), Axis=Z_5)  # -> Geometry, Transform
rot3d_2 = Rotate3D(Geometry=scale_11.Geometry, Angle=num_4, Center=Point(0, 0, 0), Axis=Z_5)  # -> Geometry, Transform
panel_10 = Panel(division_4)
rot3d_3 = Rotate3D(Geometry=scale_9.Geometry, Angle=num_4, Center=Point(0, 0, 0), Axis=Z_5)  # -> Geometry, Transform
preview_6 = CustomPreview(Geometry=rot3d_3.Geometry, Material=ColourSwatch(SwatchColor=RGBA(0, 68, 255, 59)))
preview_7 = CustomPreview(Geometry=rot3d.Geometry, Material=ColourSwatch(SwatchColor=RGB(255, 0, 90)))
preview_8 = CustomPreview(Geometry=rot3d_2.Geometry, Material=ColourSwatch(SwatchColor=RGB(136, 250, 87)))
Z_6 = UnitZ(Factor=1)
X = UnitX(Factor=1)
vec_14 = VectorXYZ(XComponent=0, YComponent=0, ZComponent=0)  # -> Vector, Length
pl_3pt_3 = Plane3Pt(PointA=Z_6, PointB=X, PointC=vec_14.Vector)
planesrf = PlaneSurface(Plane=pl_3pt_3, XSize="1", YSize="1")
X_2 = UnitX(Factor=1)
vec_15 = VectorXYZ(XComponent=0, YComponent=0, ZComponent=0)  # -> Vector, Length
python_3 = GhPythonScript(x=ma.Result, update_point=python)  # -> out, a
# ---------- python_3: Python ----------
__author__ = "sator"
__version__ = "2023.07.07"

import rhinoscriptsyntax as rs

path = "result.txt"
f = open(path, 'r')
a = f.read()
f.close()

a = "this vertex area = " + str(x) + "\n sum = " + a
# ---------- end python_3 ----------
multiplication_18 = Multiplication(A=X_2, B="100")
ln_4 = Line(StartPoint=multiplication_18, EndPoint=vec_15.Vector)
textsrf = TextOnSurface(Text=python_3.a, Font="Sans Bold:no Italic:no", Height="10", Depth=0.4, BaseLine=ln_4, BaseSurface=planesrf)
